# Grasshopper definition HopsTest.gh (Grasshopper 1.0.8)
# plug-ins: Geospiza

# ---- group: Genes
cube_vals = GenePool(Decimals=0, Maximum=500, Minimum=1, Value=[492, 492, 469])

# ---- group: Geometric_Solver
list_item = ListItem(List=cube_vals, Index=0, Wrap=True)  # -> Item, Item1, Item2
unit_z = UnitZ(Factor=list_item.Item2)
rectangle = Rectangle(Plane=PlaneXY(0, 0, 0), XSize=list_item.Item, YSize=list_item.Item1, Radius=0)  # -> Rectangle, Length
extrude = Extrude(Base=rectangle.Rectangle, Direction=unit_z)
cap_holes = CapHoles(Brep=extrude)
geometry = Geometry(cap_holes)

# ---- group: Get Genes
geneselector = GeneSelector(GeneParams=cube_vals)
genes = Text(geneselector)

# ----
ibf = Slider(0.2, range=0..1)
manhattendistance = Slider(1, range=0..1)
mr = Slider(0.01, range=0..0.01)
pops = Slider(4, range=0..10)
cr = Slider(0.6, range=0..1)
inbreedingpairing = InbreedingPairing(InBreedingFactor=ibf, DistanceFunction=manhattendistance)
twopointcrossover = TwoPointCrossover(CrossoverRate=cr)
randommutation = RandomMutation(MutationRate=mr)
populationdiversity = PopulationDiversity(Threshold=pops)
pops_2 = Slider(50, range=0..100)
mgen = Slider(10, range=0..10)
elite = Slider(1, range=0..10)
stochasticuniversalsampling = StochasticUniversalSampling()
settings = Settings(
    PopulationSize=pops_2,
    MaxGenerations=mgen,
    EliteSize=elite,
    SelectionStrategy=stochasticuniversalsampling,
    PairingStrategy=inbreedingpairing,
    CrossoverStrategy=twopointcrossover,
    MutationStrategy=randommutation,
    TerminationStrategy=populationdiversity)
settings_2 = Data(settings)

pops_3 = Slider(4, range=0..10)  # disabled
panel = Panel("""0.2
0.4""")  # disabled
manhattendistance_2 = Slider(1, range=0..1)  # disabled
panel_2 = Panel("""50
100""")  # disabled
populationdiversity_2 = PopulationDiversity(Threshold=pops_3)  # disabled
progressconvergence = ProgressConvergence(Threshold=0.1)  # disabled

# ---- group: Fitness_Function
volume = Volume(Geometry=cap_holes)  # -> Volume, Centroid
division = Division(A=volume.Volume, B="10000000")
number = Number(division)
addition = Addition(A=number)
fitness = Fitness(Fitness=addition)

# ----
inbreedingpairing_2 = InbreedingPairing(InBreedingFactor=panel, DistanceFunction=manhattendistance_2)  # disabled
merge = Merge(Data1=populationdiversity_2, Data2=progressconvergence)  # disabled
dynamicsettings = DynamicSettings(
    PopulationSizes=panel_2,
    MaxGenerations=mgen,
    EliteSizes=elite,
    SelectionStrategies=stochasticuniversalsampling,
    PairingStrategies=inbreedingpairing_2,
    CrossoverStrategies=twopointcrossover,
    MutationStrategies=randommutation,
    TerminationStrategies=merge)  # disabled

# ---- group: Geometric_Solver / RH_OUT: Data
geometry_2 = Geometry(geometry)

# ----
button = Button()  # disabled
genes_2 = Text(genes)

settings_3 = Data(settings_2)
three_material = ThreeMaterial(Color=ColourSwatch(SwatchColor=RGB(0, 0, 0)), Metalness=0, Roughness=0.5, Opacity=1)
basic_solver = BasicSolver(Genes=genes_2, Settings=settings_3, PreviewLevel=0, Run=button)  # -> Observer, StateManager, CurrentGeneration, IsRunning; disabled
web_individual = WebIndividual(Geo=geometry_2, ThreeMaterial=three_material)
web_solver = WebSolver(
    Genes=genes_2,
    Settings=settings_3,
    PreviewLevel=3,
    Activate="true",
    Endpoint="ws://127.0.0.1:8181",
    WebIndividual=web_individual)
data_recorder = DataRecorder(web_individual, DataLimit=-10, RecordData=True)
list_length = ListLength(List=data_recorder)
panel_3 = Panel(list_length)
